vi "index.gviweb"   [LabVIEW NXG 4.0.0]
panel controls:
  "leaflet locations": i32 = -1
  "google maps token": string = "Enter token to load Google Map"
panel indicators:
  "leaflet map": string
  "google map": string
uses:
  Leaflet::Map::Create Map.gvi
  Leaflet::Map::Add Open Street Map Tile Layer.gvi
  Leaflet::Marker::Create Marker.gvi
  Leaflet::Marker::Show Marker Popup.gvi
  Leaflet::Map::Destroy Map.gvi
  GoogleMap::Map::Initialize Map.gvi
  GoogleMap::Map::Create Map.gvi
diagram:
  w1 = [{"latitude"=30.2643, "longitude"=-97.7393, "text"="Austin Convention Center"}, {"latitude"=30.2653, "longitude"=-97.7472, "text"="ACL Moody theatre"}, {"latitude"=30.269, "longitude"=-97.7421, "text"="Paramount Theatre"}]
  call "Create Map.gvi"(selector=".leaflet-map") -> (map reference=w2, error out=w3)
  call "Add Open Street Map Tile Layer.gvi"(map reference in=w2, error in=w3) -> (map reference out=w4, error out=w5)
  s1 = w5  # shift register
  for {
    w6 = each element of w1
    Property Node(instance in=w6) -> ("latitude"=w9, "longitude"=w10, "text"=w11)
    call "Create Marker.gvi"(text=w11, map reference in=w4, latitude=w9, longitude=w10, error in=s1) -> (map reference out=w12, marker reference=w13, error out=w14)
    append w13 to w7
    append w11 to w8
    next s1 = w14
    stop if w14
  }
  Property Node(instance in=reference to "leaflet locations", "Items"=w8, error in=s1) -> (error out=w15)
  s2 = w15  # shift register
  while {
    event {
      on "leaflet locations" Value changed {
        Is Greater Or Equal To 0(x=$"leaflet locations") -> w18
        case (w18) {
          frame False, Default {
            w16 = s2
          }
          frame True {
            Array Index(array=w7) -> (out0[$"leaflet locations"]=w19)
            call "Show Marker Popup.gvi"(marker reference in=w19, error in=s2) -> (error out=w16)
          }
        }
        w17 = w12
      }
    }
    next s2 = w16
    stop if w16
  }
  call "Destroy Map.gvi"(map reference=w17, error in=s2)
  event {
    on "google maps token" Value changed {
      Event Data() -> ("New Value"=w21, "Control Reference"=w22)
      Property Node(instance in=w22, "Disabled"=TRUE) -> (error out=w23)
      call "Initialize Map.gvi"(api key=w21, error in=w23) -> (error out=w20)
    }
  }
  call "Create Map.gvi"(selector=".google-map", error in=w20)
